# Grasshopper definition tower_Final Project_Data_Managment.gh (Grasshopper 1.0.7)
# plug-ins: Kangaroo2 Components

# ---- group: RH_IN:floorcount
nº_floors = Slider(30, range=0..100)

# ---- group: RH_IN:buildingheight
weight = Slider(381, range=0..1000)

# ---- group: RH_IN:rotation
# Levels parameters
º_rotate = Slider(31, range=0..100)

# ---- group: RH_IN:buildinglength
# Floor Plane parameters
lenght = Slider(100, range=0..1000)

# ---- group: RH_IN:floorheight
f2f = Slider(15, range=0..100)

# ----
series = Series(Start=0, Step=f2f, Count=nº_floors)

rectangle = Rectangle(Plane=PlaneXY(0, 0, 0), XSize=lenght, YSize=weight, Radius=0)  # -> Rectangle, Length
Z = UnitZ(Factor=series)
bnd = Bounds(Numbers=series)
dom = ConstructDomain(DomainStart=0, DomainEnd=1)
move = Move(Geometry=rectangle.Rectangle, Motion=Z)  # -> Geometry, Transform
remap = RemapNumbers(Value=series, Source=bnd, Target=dom)  # -> Mapped, Clipped
area = Area(Geometry=move.Geometry)  # -> Area, Centroid
graph = GraphMapper(
    remap.Mapped,
    x0=0,
    x1=1,
    y0=0,
    y1=1,
    container_name="Bezier",
    cpx=[0, 0.4336470068, 0.3852428198, 1],
    cpy=[0, 0, 0.9941419363, 1])
multiplication = Multiplication(A=graph, B=º_rotate)
rotate = Rotate(Geometry=move.Geometry, Angle=degrees(multiplication), Plane=area.Centroid)  # -> Geometry, Transform

bal_offset = Slider(15, range=0..100)
neg = Negative(Value=bal_offset)
offset = OffsetCurve(Curve=rotate.Geometry, Distance=neg, Plane=PlaneXY(0, 0, 0), Corners=1)  # -> flatten(Curve)

Z_2 = UnitZ(Factor=Slider(1, range=0.5..1.5))
rev = Reverse(Vector=Z_2)
extr = Extrude(Base=rotate.Geometry, Direction=rev)
cap = CapHoles(Brep=extr)

bal_offset_2 = Slider(1, range=0..100)
neg_2 = Negative(Value=bal_offset_2)
offset_2 = OffsetCurve(Curve=rotate.Geometry, Distance=neg_2, Plane=PlaneXY(0, 0, 0), Corners=1)  # -> flatten(Curve)
bal_crv = Curve(offset_2)
shift = ShiftList(List=bal_crv, Shift=1, Wrap=False)
Z_3 = UnitZ(Factor=Slider(4, range=0..4))
extr_2 = Extrude(Base=shift, Direction=Z_3)

shift_2 = ShiftList(List=series, Shift=1, Wrap=False)
subtraction = Subtraction(A=shift_2, B=series)
subtraction_2 = Subtraction(A=subtraction, B="1")
Z_4 = UnitZ(Factor=subtraction_2)
shift_3 = ShiftList(List=offset, Shift=-1, Wrap=False)
shift_4 = ShiftList(List=Z_4, Shift=-1, Wrap=False)
extr_3 = Extrude(Base=shift_3, Direction=shift_4)

dist_between_columns = Slider(34, range=0..100)
explode = Explode(Curve=offset, Recursive=True)  # -> simplify(Segments), Vertices
len = Length(Curve=explode.Segments)
division = Division(A=len, B=dist_between_columns)
divide = DivideCurve(Curve=explode.Segments, Count=division, Kinks=False)  # -> Points, Tangents, Parameters
pshift = ShiftPaths(Data=simplify(divide.Points), Offset=-1)

duppt = RemoveDuplicatePts(Points=pshift, Tolerance=0.01)
pline = PolyLine(Vertices=duppt, Closed=invert(False))  # -> simplify(Polyline)
Z_5 = UnitZ(Factor=f2f)
cull_i = CullIndex(List=flatten(pline), Indices="-1", Wrap=True)  # -> graft(List)
explode_2 = Explode(Curve=cull_i, Recursive=True)  # -> simplify(Segments), Vertices
move_2 = Move(Geometry=explode_2.Segments, Motion=Z_5)  # -> simplify(graft(Geometry)), Transform
loft = Loft(
    Curves=[explode_2.Segments, move_2.Geometry],
    Options={Adjust=False, Closed=False, LoftEnds=0, LoftSimp=0, LoftType=3, Rebuild=10, Refit=0.01})
entwine = Entwine(
    Branch00=ColourSwatch(SwatchColor=RGBA(0, 191, 255, 94)),
    Branch01=ColourSwatch(SwatchColor=RGB(0, 0, 0)),
    Branch02=ColourSwatch(SwatchColor=RGB(255, 255, 255)),
    Branch03=ColourSwatch(SwatchColor=RGB(153, 153, 153)),
    Branch04=ColourSwatch(SwatchColor=RGB(0, 0, 0)),
    Branch05=ColourSwatch(SwatchColor=RGBA(0, 127, 191, 76)),
    FlattenInputs=True)

neg_3 = Negative(Value=Slider(6, range=0..10))
offset_3 = OffsetCurve(Curve=offset, Distance=neg_3, Plane=PlaneXY(0, 0, 0), Corners=1)  # -> flatten(Curve)
dist_between_columns_2 = Slider(34, range=0..100)
explode_3 = Explode(Curve=offset_3, Recursive=True)  # -> simplify(Segments), Vertices
len_2 = Length(Curve=explode_3.Segments)
division_2 = Division(A=len_2, B=dist_between_columns_2)
divide_2 = DivideCurve(Curve=explode_3.Segments, Count=division_2, Kinks=False)  # -> Points, Tangents, Parameters
pshift_2 = ShiftPaths(Data=simplify(divide_2.Points), Offset=-1)

relitem = RelativeItem(Tree=pshift_2, Offset="{+1}", WrapPaths=False, WrapItems=False)  # -> ItemA, ItemB
ln = Line(StartPoint=relitem.ItemA, EndPoint=relitem.ItemB)

pipe = Pipe(Curve=ln, Radius="1.0", Caps=0)

entwine_2 = Entwine(
    Branch00=extr_2,
    Branch01=rotate.Geometry,
    Branch02=cap,
    Branch03=pipe,
    Branch04=offset,
    Branch05=loft,
    FlattenInputs=True)
preview = CustomPreview(Geometry=entwine_2, Material=entwine)

# ---- group: RH_OUT:tower
mesh = Mesh(entwine_2)
